# Grasshopper definition 00.gh (Grasshopper 1.0.7)
# plug-ins: Heteroptera, Human, SpaceSyntaxDesign_GH

# ---- group: 3x3m square
pt = Point([Point(4185.647149, 1445.593142, 0), Point(4305.647149, 1445.593142, 0), Point(4305.647149, 1325.593142, 0), Point(4185.647149, 1325.593142, 0)])

# ---- group: points from square on camera
pt_2 = Point([Point(249.0813852, 28.99084618, 0), Point(341.6801667, 4.535270553, 0), Point(264.7519482, -48.64967063, 0), Point(162.8932885, -13.27218743, 0)])

# ---- group: 3x3m square
pt_3 = Point([Point(4185.647149, 1445.593142, 0), Point(4305.647149, 1445.593142, 0), Point(4305.647149, 1325.593142, 0), Point(4185.647149, 1325.593142, 0)])

# ---- group: points from square on camera
pt_4 = Point([Point(440.7039242, 96.86321672, 0), Point(518.6756744, 142.8841369, 0), Point(653.5140394, 102.1395006, 0), Point(589.2784887, 38.20396891, 0)])

# ----
Y = UnitY(Factor=1)
path = FilePath("C:\Users\ejara\OneDrive\Desktop\hardware\YOLO\pts_0c.csv")
number_slider = Slider(1.067, range=0..40)  # disabled
Y_2 = UnitY(Factor=1)
amp = Amplitude(Vector=Y, Amplitude=Slider(136, range=0..400))

# ---- group: points from .csv / 2 people video
path_2 = FilePath("C:\Users\ejara\OneDrive\Desktop\hardware\YOLO\pts_video2.csv")  # disabled

# ---- group: points from .csv / 1 person video
path_3 = FilePath("C:\Users\ejara\OneDrive\Desktop\hardware\YOLO\pts_try1.csv")  # disabled

# ---- group: tables
panel = Panel("200")  # disabled
# FURNITURE DATA SET
panel_2 = Panel("244")  # disabled
panel_3 = Panel("122")  # disabled
panel_4 = Panel("120")  # disabled
panel_5 = Panel("60")  # disabled
panel_6 = Panel("80")  # disabled
rectangle = Rectangle(Plane=PlaneXY(0, 0, 0), XSize=panel, YSize=panel_5, Radius=0)  # -> Rectangle, Length; disabled
rectangle_2 = Rectangle(Plane=PlaneXY(0, 0, 0), XSize=panel_2, YSize=panel_3, Radius=0)  # -> Rectangle, Length; disabled
rectangle_3 = Rectangle(Plane=PlaneXY(0, 0, 0), XSize=panel_4, YSize=panel_6, Radius=0)  # -> Rectangle, Length; disabled
panel_7 = Panel("5")  # disabled
panel_8 = Panel("1")  # disabled
panel_9 = Panel("26")  # disabled
multiplication = Multiplication(A=rectangle.Rectangle, B=panel_7)  # disabled
multiplication_2 = Multiplication(A=rectangle_2.Rectangle, B=panel_9)  # disabled
multiplication_3 = Multiplication(A=rectangle_3.Rectangle, B=panel_8)  # disabled

# ---- group: chairs
panel_10 = Panel("50")  # disabled
panel_11 = Panel("50")  # disabled
rectangle_4 = Rectangle(Plane=PlaneXY(0, 0, 0), XSize=panel_10, YSize=panel_11, Radius=0)  # -> Rectangle, Length; disabled
panel_12 = Panel("134")  # disabled
multiplication_4 = Multiplication(A=rectangle_4.Rectangle, B=panel_12)  # disabled

# ----
item = ListItem(List=pt_3, Index=Slider(3, range=0..3), Wrap=True)

# ---- group: points from .csv / 4 people video
path_4 = FilePath("C:\Users\ejara\OneDrive\Desktop\hardware\YOLO\csv\pts_video4.csv")  # disabled

# ----
path_5 = FilePath("C:\Users\ejara\OneDrive\Desktop\hardware\YOLO\pts_try4_append")

# ---- group: mapped path points
file = ReadFile(File=path, PerLineParse=True)
split = TextSplit(Text=file, Separators=",")
dispatch = Dispatch(List=split, DispatchPattern=[True, False])  # -> ListA, ListB
pt_5 = ConstructPoint(XCoordinate=dispatch.ListA, YCoordinate=dispatch.ListB, ZCoordinate=0)

# ----
amp_2 = Amplitude(Vector=Y_2, Amplitude=Slider(26, range=0..400))
Z = UnitZ(Factor=1)  # disabled
move = Move(Geometry=pt_2, Motion=amp)  # -> Geometry, Transform

# ---- group: mapped path points
file_2 = ReadFile(File=path_5, PerLineParse=True)
split_2 = TextSplit(Text=file_2, Separators=",")
dispatch_2 = Dispatch(List=split_2, DispatchPattern=[True, False])  # -> ListA, ListB
pt_6 = ConstructPoint(XCoordinate=dispatch_2.ListA, YCoordinate=dispatch_2.ListB, ZCoordinate=0)

# ---- group: points from .csv / mapped path points
file_3 = ReadFile(File=path_4, PerLineParse=True)  # disabled
panel_13 = Panel(",")  # disabled
split_3 = TextSplit(Text=file_3, Separators=panel_13)  # disabled
dispatch_3 = Dispatch(List=split_3, DispatchPattern=[True, False])  # -> ListA, ListB; disabled
pt_7 = ConstructPoint(XCoordinate=dispatch_3.ListA, YCoordinate=dispatch_3.ListB, ZCoordinate=0)  # disabled

# ----
number_slider_2 = Slider(0.7, range=0..4)  # disabled
move_2 = Move(Geometry=pt_4, Motion=amp_2)  # -> Geometry, Transform

# ---- group: space 2
pt_8 = Point(Point(-16.07425441, 523.5989947, 0))  # disabled

# ---- group: hall1
pt_9 = Point(Point(-34.66558366, 517.4074387, 0))  # disabled

# ---- group: space 1
pt_10 = Point(Point(-24.51376274, 523.7868061, 0))  # disabled

# ---- group: space 3
pt_11 = Point(Point(-7.853216138, 523.6630588, 0))  # disabled

# ---- group: lab
pt_12 = Point(Point(-16.04598152, 514.9106814, 0))  # disabled

# ----
circle = CircleCNR(Center=pt_7, Normal=Z, Radius=number_slider)  # disabled

# ---- group: meeting room 1
pt_13 = Point(Point(-35.0945814, 523.0735709, 0))  # disabled

# ---- group: meeting room 2
pt_14 = Point(Point(-1.661329801, 525.6085683, 0))  # disabled

# ---- group: bathroom
pt_15 = Point(Point(-1.601214037, 519.8814754, 0))  # disabled

# ----
swatch = ColourSwatch(SwatchColor=RGB(227, 179, 179))  # disabled
# Room Areas
genes = GenePool(Decimals=2, Maximum=20, Minimum=2, Value=[9.09, 9.54, 20, 20, 11.12, 9.29, 7.52, 10.11])  # disabled
previewlw = CustomPreviewLineweights(Geometry=circle, Shader=swatch, Thickness=number_slider_2, Absolute=False)  # disabled
panel_14 = Panel("""hall 1
space 1
space 2
space 3
meeting room 1
meeting room 2
bathroom
lab""")  # disabled
pt_16 = Point(Point(437.7541176, 234.5954441, 0))
merge = Merge(Data1=pt_9, Data2=pt_10, Data3=pt_8, Data4=pt_11, Data5=pt_13, Data6=pt_14, Data7=pt_15, Data8=pt_12)  # disabled
series = Series(Start="0", Step=1, Count=Slider(1000, range=0..1000))

# ---- group: points from .csv / points from square on camera
pt_17 = Point([Point(652.2910089, 737.2565492, 0), Point(1434.594771, 901.0935111, 0), Point(1165.079422, 1256.428221, 0), Point(599.806441, 1167.771856, 0)])  # disabled

# ---- group: points from .csv / 3x3m square
pt_18 = Point([Point(652.2910089, 737.2565492, 0), Point(952.2910089, 737.2565492, 0), Point(952.2910089, 1037.256549, 0), Point(652.2910089, 1037.256549, 0)])  # disabled

# ----
xy = XYPlane(Origin=pt_16)

# ---- group: perspective transformation
c_script = CSharpScript(Tin=move.Geometry, Tout=pt, Pin=pt_5)  # -> Pout; inputs Tin: list of Point3d, Tout: list of Point3d, Pin: Point3d
# ---------- c_script: C# ----------
    int i = 0;

    Matrix A = new Matrix(8, 8);
    A.Zero();

    for(i = 0; i < 4;i++){
      A[2 * i, 2] = 1;
      A[2 * i + 1, 5] = 1;

      A[2 * i, 0] = Tin[i].X;
      A[2 * i, 1] = Tin[i].Y;
      A[2 * i + 1, 3] = Tin[i].X;
      A[2 * i + 1, 4] = Tin[i].Y;

      A[2 * i, 6] = -Tin[i].X * Tout[i].X;
      A[2 * i, 7] = -Tin[i].Y * Tout[i].X;
      A[2 * i + 1, 6] = -Tin[i].X * Tout[i].Y;
      A[2 * i + 1, 7] = -Tin[i].Y * Tout[i].Y;
    }
    A.Invert(0);

    Matrix B = new Matrix(8, 1);
    for(i = 0; i < 4;i++){
      B[2 * i, 0] = Tout[i].X;
      B[2 * i + 1, 0] = Tout[i].Y;
    }

    Matrix H = new Matrix(8, 1);
    H = A * B;

    Matrix H3 = new Matrix(3, 3);
    for(i = 0; i < 8;i++)
      H3[i / 3, i % 3] = H[i, 0];
    H3[2, 2] = 1;

    Matrix mPin = new Matrix(3, 1);
    mPin[0, 0] = Pin.X;
    mPin[1, 0] = Pin.Y;
    mPin[2, 0] = 1;

    Matrix mPout = new Matrix(3, 1);
    mPout = H3 * mPin;

    Point3d P = new Point3d();
    P.X = mPout[0, 0] / mPout[2, 0];
    P.Y = mPout[1, 0] / mPout[2, 0];

    Pout = P;
# ---------- end c_script ----------

# ----
item_2 = ListItem(List=flatten(pt_5), Index=Slider(5, range=0..100), Wrap=True)

# ---- group: perspective transformation
c_script_2 = CSharpScript(Tin=move_2.Geometry, Tout=pt_3, Pin=pt_6)  # -> Pout; inputs Tin: list of Point3d, Tout: list of Point3d, Pin: Point3d; same code as c_script

# ---- group: points from .csv / perspective transformation
c_script_3 = CSharpScript(Tin=pt_17, Tout=pt_18, Pin=pt_7)  # -> Pout; inputs Tin: list of Point3d, Tout: list of Point3d, Pin: Point3d; disabled; same code as c_script

# ----
rotate = Rotate(Geometry=pt_6, Angle=degrees(Slider(180, range=0..360)), Plane=xy)  # -> Geometry, Transform
item_3 = ListItem(List=pt, Index=Slider(3, range=0..3), Wrap=True)
# connectivity
crv = Curve([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])  # disabled
item_4 = ListItem(List=pt_3, Index=Slider(3, range=0..3), Wrap=True)

# ---- group: mapped path
pt_19 = Point(c_script)

# ----
number_slider_3 = Slider(92.78, range=0..100)  # disabled
number_slider_4 = Slider(50, range=50..200)  # disabled
number_slider_5 = Slider(200, range=0..200)  # disabled
item_5 = ListItem(List=flatten(rotate.Geometry), Index=series, Wrap=True)

# ---- group: mapped path
pt_20 = Point(c_script_2)

# ---- group: points from .csv / mapped path
pt_21 = Point(c_script_3)  # disabled

# ----
item_6 = ListItem(List=flatten(pt_20), Index=Slider(200, range=0..200), Wrap=True)
Y_3 = UnitY(Factor=1)  # disabled
pt_22 = Point(merge)  # disabled
Y_4 = UnitY(Factor=1)  # disabled
amp_3 = Amplitude(Vector=Y_3, Amplitude=expr("-x", number_slider_3))  # disabled
pt_23 = Point(flatten(pt_21))  # disabled
number_slider_6 = Slider(2035, range=0..2035)  # disabled

# ---- group: floor
srf = Surface(<surface referenced from the Rhino model>)

# ----
nodelinkgraph = GraphFromNodesLinks(Points=pt_22, Links=crv, Labels=panel_14, Areas=genes, TotalArea=number_slider_4)  # -> Graph, GraphVertices, Attributes; disabled

# ---- group: heatmap generator / floor
srf_2 = Surface(<surface referenced from the Rhino model>)  # disabled

# ----
amp_4 = Amplitude(Vector=Y_4, Amplitude=expr("-x", number_slider_5))  # disabled
number_slider_7 = Slider(26, range=0..40)  # disabled
move_3 = Move(Geometry=pt_18, Motion=amp_3)  # -> Geometry, Transform; disabled
edges = BrepEdges(Brep=srf)  # -> Naked, Interior, NonManifold

# ---- group: heatmap generator / floor
srf_3 = Surface(<surface referenced from the Rhino model>)  # disabled

# ----
toggle = BooleanToggle(True)  # disabled
number_slider_8 = Slider(26, range=0..40)  # disabled
move_4 = Move(Geometry=pt_17, Motion=amp_4)  # -> Geometry, Transform; disabled
panel_15 = Panel("0")  # disabled
integration = IntegrationAnalysis(Graph=nodelinkgraph.Graph, Attributes=nodelinkgraph.Attributes)  # -> DepthTable, DepthMap, RelativeASymetry, Integration, IntegrationRelativeColors, IntegrationTags; disabled

# ---- group: lazne tacke
pt_24 = Point([<point referenced from the Rhino model> x389])

# ----
move_5 = Move(Geometry=pt_7, Motion=amp_3)  # -> Geometry, Transform; disabled
number_slider_9 = Slider(2, range=0..2)  # disabled
forcedirecteddrawing = ForceDirectedDrawing(
    Graph=nodelinkgraph.Graph,
    Vertices=nodelinkgraph.GraphVertices,
    Attributes=nodelinkgraph.Attributes,
    AttractionStrength=0.25,
    RepulsionStrength=1.4,
    ConvergenceTolearnce=0.001,
    MaximumIterations=4000,
    Active=toggle)  # -> NewGraphVertices, IterationCount; disabled
len = Length(Curve=edges.Naked)
series_2 = Series(Start=panel_15, Step=1, Count=number_slider_6)  # disabled
xy_2 = XYPlane(Origin=move_3.Geometry)  # disabled
control = ControlAnalysis(Graph=nodelinkgraph.Graph, Attributes=nodelinkgraph.Attributes)  # -> Control, ControlRelativeColors, ControlTags; disabled
number_slider_10 = Slider(2, range=0..2)  # disabled
entropy = EntropyAnalysis(
    Graph=nodelinkgraph.Graph,
    Attributes=nodelinkgraph.Attributes,
    DepthTable=integration.DepthTable,
    DepthMap=integration.DepthMap)  # -> Entropy, EntropyRelativeColors, EntropyTags; disabled
choice = ChoiceAnalysis(Graph=nodelinkgraph.Graph, Attributes=nodelinkgraph.Attributes)  # -> ShortestPaths, ChoiceBetweenness, ChoiceRelativeColors, ChoiceTags; disabled
panel_16 = Panel(series_2)  # disabled
xy_3 = XYPlane(Origin=move_4.Geometry)  # disabled

# ---- group: square size
panel_17 = Panel("30")

# ----
item_7 = ListItem(List=pt_23, Index=series_2, Wrap=True)  # disabled
sort = SortList(Keys=integration.Integration, ValuesA=integration.IntegrationRelativeColors, ValuesB=integration.IntegrationTags)  # -> Keys, ValuesA, ValuesB; disabled
sort_2 = SortList(Keys=control.Control, ValuesA=control.ControlRelativeColors, ValuesB=control.ControlTags)  # -> Keys, ValuesA, ValuesB; disabled
number_slider_11 = Slider(0.13, range=0..3)  # disabled
division = Division(A=len, B=panel_17)
sort_3 = SortList(Keys=entropy.Entropy, ValuesA=entropy.EntropyRelativeColors, ValuesB=entropy.EntropyTags)  # -> Keys, ValuesA, ValuesB; disabled
sort_4 = SortList(Keys=choice.ChoiceBetweenness, ValuesA=choice.ChoiceRelativeColors, ValuesB=choice.ChoiceTags)  # -> Keys, ValuesA, ValuesB; disabled
number_slider_12 = Slider(4.251, range=0..30)  # disabled
number_slider_13 = Slider(14.196, range=0..30)  # disabled
cir = Circle(Plane=xy_2, Radius=number_slider_9)  # disabled
justifiedgraph = JustifiedGraphDrawing(
    ViewPointIndex=0,
    Plane=PlaneXY(-11.3041567, 519.0965591, 0),
    Size=10,
    Thickness=1,
    Graph=nodelinkgraph.Graph,
    Attributes=nodelinkgraph.Attributes)  # disabled
diskograph = DiskoGraphDrawing(
    Plane=PlaneXY(-3.585191115, 516.8597194, 0),
    Graph=nodelinkgraph.Graph,
    Vertices=forcedirecteddrawing.NewGraphVertices,
    Attributes=nodelinkgraph.Attributes,
    Thickness=1)  # disabled
xy_4 = XYPlane(Origin=item_7)  # disabled
legend = Legend(
    Colour=sort_2.ValuesA,
    Tags=sort_2.ValuesB,
    Rectangle={Plane=PlaneXY(-13.86715773, 499.1019762, 0), Size=Domain2(u=-1.888634095..1.888634095, v=-3.27121021..3.27121021)},
    LegendType=1)  # disabled

# ---- group: vertikala
item_8 = ListItem(List=division, Index="1", Wrap=True)

# ----
number_slider_14 = Slider(14.196, range=0..30)  # disabled
legend_2 = Legend(
    Colour=sort.ValuesA,
    Tags=sort.ValuesB,
    Rectangle={Plane=PlaneXY(-19.22012737, 499.1019762, 0), Size=Domain2(u=-1.888634095..1.888634095, v=-3.27121021..3.27121021)},
    LegendType=1)  # disabled
number_slider_15 = Slider(2035, range=0..2035)  # disabled

# ---- group: horizontala
item_9 = ListItem(List=division, Index=0, Wrap=True)

# ----
cir_2 = Circle(Plane=xy_3, Radius=number_slider_10)  # disabled
legend_3 = Legend(
    Colour=sort_4.ValuesA,
    Tags=sort_4.ValuesB,
    Rectangle={Plane=PlaneXY(-3.161218468, 499.1019762, 0), Size=Domain2(u=-1.888634095..1.888634095, v=-3.27121021..3.27121021)},
    LegendType=1)  # disabled
cir_3 = Circle(Plane=xy_4, Radius=number_slider_11)  # disabled
swatch_2 = ColourSwatch(SwatchColor=RGB(0, 255, 247))  # disabled
swatch_3 = ColourSwatch(SwatchColor=RGB(255, 0, 0))  # disabled
legend_4 = Legend(
    Colour=sort_3.ValuesA,
    Tags=sort_3.ValuesB,
    Rectangle={Plane=PlaneXY(-8.514188101, 499.1019762, 0), Size=Domain2(u=-1.888634095..1.888634095, v=-3.27121021..3.27121021)},
    LegendType=1)  # disabled
swatch_4 = ColourSwatch(SwatchColor=RGB(255, 0, 0))  # disabled
pt_25 = Point(flatten(pt_7))  # disabled
divide = DivideDomain²(Domain=srf, UCount=item_9, VCount=item_8)
previewlw_2 = CustomPreviewLineweights(Geometry=cir_3, Shader=swatch_2, Thickness=number_slider_12, Absolute=False)  # disabled
previewlw_3 = CustomPreviewLineweights(Geometry=cir, Shader=swatch_3, Thickness=number_slider_13, Absolute=False)  # disabled
number_slider_16 = Slider(0.44, range=0..2)  # disabled
panel_18 = Panel("0")  # disabled
previewlw_4 = CustomPreviewLineweights(Geometry=cir_2, Shader=swatch_4, Thickness=number_slider_14, Absolute=False)  # disabled
series_3 = Series(Start=panel_18, Step=1, Count=number_slider_15)  # disabled

# ---- group: list of surfaces
subsrf = Isotrim(Surface=srf, Domain=divide)  # -> graft(Surface)

# ----
item_10 = ListItem(List=pt_25, Index=series_3, Wrap=True)  # disabled
xy_5 = XYPlane(Origin=item_10)  # disabled
edges_2 = BrepEdges(Brep=subsrf)  # -> Naked, Interior, NonManifold
number_slider_17 = Slider(26, range=0..40)  # disabled
cir_4 = Circle(Plane=xy_5, Radius=number_slider_16)  # disabled
swatch_5 = ColourSwatch(SwatchColor=RGB(0, 255, 247))  # disabled
panel_19 = Panel(pt_25)  # disabled
brep_cp = BrepClosestPoint(Point=flatten(pt_24), Brep=subsrf)  # -> Point, Normal, Distance
number_slider_18 = Slider(3, range=0..3)  # disabled
item_11 = ListItem(List=subsrf, Index=number_slider_17, Wrap=True)  # disabled
previewlw_5 = CustomPreviewLineweights(
    Geometry=edges_2.Naked,
    Shader=ColourSwatch(SwatchColor=RGB(255, 0, 0)),
    Thickness=Slider(0.1, range=0..10),
    Absolute=False)
previewlw_6 = CustomPreviewLineweights(Geometry=cir_4, Shader=swatch_5, Thickness=number_slider_12, Absolute=False)  # disabled
item_12 = ListItem(List=subsrf, Index=number_slider_18, Wrap=True)  # disabled
panel_20 = Panel("0")  # disabled
panel_21 = Panel("0")  # disabled
smaller = SmallerThan(FirstNumber=brep_cp.Distance, SecondNumber=Slider(0.000167, range=0..0.001))  # -> SmallerThan, OrEqualTo

# ---- group: list of number of points per srf
ma = MassAddition(Input=smaller.SmallerThan)  # -> Result, PartialResults

# ----
extremums = MinMax(Number=ma.PartialResults)  # -> Minimum, Maximum; disabled
number_slider_19 = Slider(7.4, range=0..100)
panel_22 = Panel("0")  # disabled
dom = ConstructDomain(DomainStart="0", DomainEnd="15")
dom_2 = ConstructDomain(DomainStart="0", DomainEnd="1")
series_4 = Series(Start=0, Step=Slider(0.0085, range=0..0.1), Count=10)
remap = RemapNumbers(Value=ma.Result, Source=dom, Target=dom_2)  # -> Mapped, Clipped
gradient = Gradient(
    LowerLimit=0,
    UpperLimit=remap.Mapped,
    Parameter=series_4,
    stops=[0: RGB(0, 0, 0), 0.0303: RGB(173, 252, 255), 1: RGB(26, 36, 35)])
gradient_2 = Gradient(LowerLimit=0, UpperLimit=remap.Mapped, Parameter=series_4, stops=[0: RGB(255, 255, 255), 1: RGB(0, 64, 64)])
previewmat = CustomPreviewMaterials(Geometry=subsrf, DiffuseColor=gradient, Transparency=panel_22)  # disabled
preview = CustomPreview(Geometry=subsrf, Material=gradient)

# ---- group: heatmap generator
number_slider_20 = Slider(47, range=0..50)  # disabled
panel_23 = Panel("70")  # disabled
divide_2 = DivideDomain²(Domain=srf_2, UCount=panel_23, VCount=panel_23)  # disabled
number_slider_21 = Slider(3, range=0..3)  # disabled
number_slider_22 = Slider(0.000167, range=0..0.001)  # disabled
number_slider_23 = Slider(7.4, range=0..100)  # disabled
number_slider_24 = Slider(0.0085, range=0..0.1)  # disabled
panel_24 = Panel("0")  # disabled
panel_25 = Panel("15")  # disabled
panel_26 = Panel("0")  # disabled
panel_27 = Panel("1")  # disabled
dom_3 = ConstructDomain(DomainStart=panel_24, DomainEnd=panel_25)  # disabled
dom_4 = ConstructDomain(DomainStart=panel_26, DomainEnd=panel_27)  # disabled
series_5 = Series(Start=0, Step=number_slider_24, Count=10)  # disabled

# ---- group: heatmap generator / list of surfaces
subsrf_2 = Isotrim(Surface=srf_2, Domain=divide_2)  # -> graft(Surface); disabled

# ----
item_13 = ListItem(List=subsrf_2, Index=number_slider_7, Wrap=True)  # disabled

# ---- group: heatmap generator
number_slider_25 = Slider(47, range=0..50)  # disabled
panel_28 = Panel("70")  # disabled
divide_3 = DivideDomain²(Domain=srf_3, UCount=panel_28, VCount=panel_28)  # disabled
number_slider_26 = Slider(3, range=0..3)  # disabled
number_slider_27 = Slider(0.000167, range=0..0.001)  # disabled
number_slider_28 = Slider(7.4, range=0..100)  # disabled
number_slider_29 = Slider(0.0085, range=0..0.1)  # disabled
panel_29 = Panel("0")  # disabled
panel_30 = Panel("15")  # disabled
panel_31 = Panel("1")  # disabled
panel_32 = Panel("0")  # disabled
dom_5 = ConstructDomain(DomainStart=panel_29, DomainEnd=panel_30)  # disabled
dom_6 = ConstructDomain(DomainStart=panel_32, DomainEnd=panel_31)  # disabled
series_6 = Series(Start=0, Step=number_slider_29, Count=10)  # disabled

# ---- group: heatmap generator / list of surfaces
subsrf_3 = Isotrim(Surface=srf_3, Domain=divide_3)  # -> graft(Surface); disabled

# ----
item_14 = ListItem(List=subsrf_3, Index=number_slider_8, Wrap=True)  # disabled

# ---- group: heatmap generator (continued)
item_15 = ListItem(List=subsrf_2, Index=number_slider_21, Wrap=True)  # disabled
brep_cp_2 = BrepClosestPoint(Point=flatten(pt_19), Brep=subsrf_2)  # -> Point, Normal, Distance; disabled
smaller_2 = SmallerThan(FirstNumber=brep_cp_2.Distance, SecondNumber=number_slider_22)  # -> SmallerThan, OrEqualTo; disabled

# ---- group: heatmap generator / list of number of points per srf
ma_2 = MassAddition(Input=smaller_2.SmallerThan)  # -> Result, PartialResults; disabled

# ---- group: heatmap generator (continued)
extremums_2 = MinMax(Number=ma_2.PartialResults)  # -> Minimum, Maximum; disabled
remap_2 = RemapNumbers(Value=ma_2.Result, Source=dom_3, Target=dom_4)  # -> Mapped, Clipped; disabled
gradient_3 = Gradient(
    LowerLimit=0,
    UpperLimit=remap_2.Mapped,
    Parameter=series_5,
    stops=[0: RGB(0, 0, 0), 0.0303: RGB(0, 128, 0), 1: RGB(255, 0, 0)])  # disabled
preview_2 = CustomPreview(Geometry=subsrf_2, Material=gradient_3)  # disabled

# ----
previewmat_2 = CustomPreviewMaterials(Geometry=subsrf_2, DiffuseColor=gradient_3, Transparency=panel_20)  # disabled

# ---- group: heatmap generator (continued)
item_16 = ListItem(List=subsrf_3, Index=number_slider_26, Wrap=True)  # disabled
brep_cp_3 = BrepClosestPoint(Point=flatten(pt_21), Brep=subsrf_3)  # -> Point, Normal, Distance; disabled
smaller_3 = SmallerThan(FirstNumber=brep_cp_3.Distance, SecondNumber=number_slider_27)  # -> SmallerThan, OrEqualTo; disabled

# ---- group: heatmap generator / list of number of points per srf
ma_3 = MassAddition(Input=smaller_3.SmallerThan)  # -> Result, PartialResults; disabled

# ---- group: heatmap generator (continued)
extremums_3 = MinMax(Number=ma_3.PartialResults)  # -> Minimum, Maximum; disabled
remap_3 = RemapNumbers(Value=ma_3.Result, Source=dom_5, Target=dom_6)  # -> Mapped, Clipped; disabled
gradient_4 = Gradient(
    LowerLimit=0,
    UpperLimit=remap_3.Mapped,
    Parameter=series_6,
    stops=[0: RGB(0, 0, 0), 0.0303: RGB(0, 128, 0), 1: RGB(255, 0, 0)])  # disabled
preview_3 = CustomPreview(Geometry=subsrf_3, Material=gradient_4)  # disabled

# ----
previewmat_3 = CustomPreviewMaterials(Geometry=subsrf_3, DiffuseColor=gradient_4, Transparency=panel_21)  # disabled
